# Dynamo graph materials colors extractor.dyn (Dynamo 2.2.1.5175)

file_path = Filename("Z:\output.csv")
categories = Categories("OST_Materials")
all_elements_of_category = ElementsOfCategory(Category=categories)
name = Material.Name(material=all_elements_of_category)
color = Material.Color(material=all_elements_of_category)
list_create = List.Create(item0=name, item1=color)
exportCSV = Data.ExportCSV(filePath=file_path, data=list_create)
