# Dynamo graph materials colors extractor.dyn (Dynamo 2.2.1.5175)

file_path = Filename("Z:\output.csv")
categories = Categories("OST_Materials")
all_elements_of_category = ElementsOfCategory(Category=categories)
name = Material.Name(material=all_elements_of_category)
string = StringInput(",")
string_2 = StringInput(";")
replace = String.Replace(searchFor=string, replaceWith=string_2)  # unwired: str
map = List.Map(list=name, f_x=replace)
color = Material.Color(material=all_elements_of_category)
map_2 = List.Map(list=color, f_x=replace)
list_create = List.Create(item0=map, item1=map_2)
exportCSV = Data.ExportCSV(filePath=file_path, data=list_create)
